# Grasshopper definition rh-gh-td_demo gh def.gh (Grasshopper 1.0.7)
# plug-ins: LunchBox, gHowl

xz = XZPlane(Origin=Point(0, 0, 0))
platotetra = PlatonicTetrahedron(Plane=xz, Radius=Slider(1.374, range=-1.001..2), Truncation=Slider(0.728453, range=-1..1))
tri = Triangulate(Mesh=platotetra)  # -> Mesh, Count
demesh = DeconstructMesh(Mesh=tri.Mesh)  # -> Vertices, Faces, Colours, Normals
panel = Panel(demesh.Faces)
python = PythonScript(F=panel)  # -> out, a
# ---------- python: Python ----------
# F faces
import re
pattern = re.compile("\{(.*?)\}")
pat = pattern.findall(F)
ids = pat[0].split(";")
a = ids
# ---------- end python ----------
item = ListItem(List=demesh.Vertices, Index=python.a, Wrap=True)
item_2 = ListItem(List=demesh.Normals, Index=python.a, Wrap=True)
flatten = FlattenTree(Tree=item, Path="{0}")
flatten_2 = FlattenTree(Tree=item_2, Path="{0}")

# ---- group: ordered verts
panel_2 = Panel(flatten)

# ---- group: ordered normals
panel_3 = Panel(flatten_2)

# ----
address_pattern = Panel("/points")
python_2 = PythonScript(Verts=panel_2, Normals=panel_3)  # -> out, a
# ---------- python_2: Python ----------
# F faces
import re
pattern = re.compile("\{(.*?)\}")
v = pattern.findall(Verts)[0].split(",")
n = pattern.findall(Normals)[0].split(",")
Pw = "1"
a = " ".join([v[0], v[1], v[2], Pw, n[0], n[1], n[2]])
# ---------- end python_2 ----------
panel_4 = Panel([address_pattern, python_2.a])
send_pattern_osc = Panel("999")
port = Panel("9999")
udp = UDPSender(Port=port, Pattern=send_pattern_osc, Data=panel_4)
